# Dynamo custom node GIS2BIM.GeoservicesLibraryNetherland_MLA.dyf "GIS2BIM.GeoservicesLibraryNetherlands_MLA" (Dynamo 2.0.2.6826)
# category: MLA+
# GeoservicesLibraryNetherlands_MLA

code_block = CodeBlock { "http://geodata.nationaalgeoregister.nl/cbsvierkanten100mv2/ows?service=WMS&request=GetLegendGraphic&format=image%2Fpng&width=20&height=20&layer=vierkant100m2011&style=cbsvierkanten100m_woz_waarde_woning"; }
n06_legenda_WOZ = Output(code_block)  # "06 legenda WOZ"
link_kadaster = CodeBlock()
# ---------- link_kadaster.designscript (5 lines) ----------
"http://geodata.nationaalgeoregister.nl/";
"kadastralekaartv3/wfs?";
"&request=GetFeature";
"&typeName=kadastralekaartv3:annotatie";
"&bbox=";
# ----------------------------------------
BoundingBox = Input(BoundingBox: var[]..[])
concat = String.Concat(string0=link_kadaster.out0, string1=link_kadaster.out1, string2=link_kadaster.out2, string3=link_kadaster.out3, string4=link_kadaster.out4, string5=BoundingBox)
n07_kadastrale_annotatie_OGC_WFS = Output(concat)  # "07 kadastrale annotatie(OGC WFS)"
link_kadaster_2 = CodeBlock()
# ---------- link_kadaster_2.designscript (5 lines) ----------
"http://geodata.nationaalgeoregister.nl/";
"kadastralekaartv3/wfs?";
"&request=GetFeature";
"&typeName=kadastralekaartv3:perceel";
"&bbox=";
# ----------------------------------------
concat_2 = String.Concat(string0=link_kadaster_2.out0, string1=link_kadaster_2.out1, string2=link_kadaster_2.out2, string3=link_kadaster_2.out3, string4=link_kadaster_2.out4, string5=BoundingBox)
n08_kadastrale_perceel_OGC_WFS = Output(concat_2)  # "08 kadastrale perceel(OGC WFS)"
link_kadaster_3 = CodeBlock()
# ---------- link_kadaster_3.designscript (6 lines) ----------
"http://services.rce.geovoorziening.nl/rce/wfs?";
"SERVICE=wfs";
"&VERSION=2.0.0";
"&request=GetFeature";
"&typeName=rce:NationalListedMonuments";
"&bbox=";
# ----------------------------------------
concat_3 = String.Concat(string0=link_kadaster_3.out0, string1=link_kadaster_3.out1, string2=link_kadaster_3.out2, string3=link_kadaster_3.out3, string4=link_kadaster_3.out4, string5=link_kadaster_3.out5, string6=BoundingBox)
n09_rijksmonumenten_OGC_WFS = Output(concat_3)  # "09 rijksmonumenten(OGC WFS)"
link_kadaster_4 = CodeBlock()
# ---------- link_kadaster_4.designscript (11 lines) ----------
"http://geodata.nationaalgeoregister.nl/";
"plu/wms?";
"&request=GetMap";
"&VERSION=1.3.0";
"&STYLES=Bouwvlak";
"&layers=Bouwvlak";
"&bbox=";
"&width=2000";
"&height=2000";
"&format=image/png";
"&crs=EPSG:28992";
# ----------------------------------------
concat_4 = String.Concat(string0=link_kadaster_4.out0, string1=link_kadaster_4.out1, string2=link_kadaster_4.out2, string3=link_kadaster_4.out3, string4=link_kadaster_4.out4, string5=link_kadaster_4.out5, string6=link_kadaster_4.out6, string7=BoundingBox, string8=link_kadaster_4.out7, string9=link_kadaster_4.out8, string10=link_kadaster_4.out9, string11=link_kadaster_4.out10)
n10_bestemmingsplan_bouwvlak_OGC_WMS = Output(concat_4)  # "10 bestemmingsplan bouwvlak(OGC WMS)"
code_block_2 = CodeBlock()
# ---------- code_block_2.designscript (12 lines) ----------
"http://afnemers.ruimtelijkeplannen.nl/afnemers2012/services?";
"REQUEST=GetMap&SERVICE=WMS";
"&VERSION=1.3.0";
"&WIDTH=2000";
"&HEIGHT=2000";
"&LAYERS=BP:Bestemmingsplangebied,BP:Enkelbestemming,BP:Dubbelbestemming,BP:Functieaanduiding,BP:Figuur,BP:Gebiedsaanduiding,BP:Gebiedsaanduiding_overzicht,BP:Wijzigingsplangebied,BP:Bouwaanduiding,BP:Bouwvlak,BP:Inpassingsplangebied,BP:Lettertekenaanduiding,BP:Maatvoering,BP:Rijksbestemmingsplangebied,BP:Uitwerkingsplangebied";
"&STYLES=";
"&TRANSPARENT=TRUE";
"&FORMAT=image/png";
"&BBOX=";
"&CRS=urn:ogc:def:crs:EPSG::28992";
"&STYLES=default";
# ----------------------------------------
concat_5 = String.Concat(string0=code_block_2.out0, string1=code_block_2.out1, string2=code_block_2.out2, string3=code_block_2.out3, string4=code_block_2.out4, string5=code_block_2.out5, string6=code_block_2.out6, string7=code_block_2.out7, string8=code_block_2.out8, string9=code_block_2.out9, string10=BoundingBox, string11=code_block_2.out10, string12=code_block_2.out11)
n11_ruimtelijkeplannen_OGC_WMS = Output(concat_5)  # "11 ruimtelijkeplannen(OGC WMS)"
code_block_3 = CodeBlock { "http://geodata.nationaalgeoregister.nl/ahn3/wfs?"; "&request=GetFeature&typeName="; "ahn3_bladindex&"; "bbox="; }
concat_6 = String.Concat(string0=code_block_3.out0, string1=code_block_3.out1, string2=code_block_3.out2, string3=code_block_3.out3, string4=BoundingBox)
n13_AHN3_webrequest_bladindex_OGC_WFS = Output(concat_6)  # "13 AHN3 webrequest bladindex(OGC WFS)"
link_kadaster_5 = CodeBlock()
# ---------- link_kadaster_5.designscript (6 lines) ----------
"http://3dbag.bk.tudelft.nl/";
"data/wfs?";
"&request=GetFeature";
"&typeName=BAG3D:pand3d";
"&outputFormat=GML3";
"&bbox=";
# ----------------------------------------
concat_7 = String.Concat(string0=link_kadaster_5.out0, string1=link_kadaster_5.out1, string2=link_kadaster_5.out2, string3=link_kadaster_5.out3, string4=link_kadaster_5.out4, string5=link_kadaster_5.out5, string6=BoundingBox)
n14_3D_BAG_TU_Delft_OGC = Output(concat_7)  # "14 3D BAG TU Delft(OGC:WFS)"
link_kadaster_6 = CodeBlock()
# ---------- link_kadaster_6.designscript (11 lines) ----------
"http://geodata.rivm.nl/";
"geoserver/alo/wms??";
"&request=GetMap";
"&VERSION=1.3.0";
"&STYLES=rivm_20180205_g_geluidkaart_lden_alle_bronnen";
"&layers=rivm_20180205_g_geluidkaart_lden_wegverkeer";
"&bbox=";
"&width=2000";
"&height=2000";
"&format=image/png";
"&crs=EPSG:28992";
# ----------------------------------------
concat_8 = String.Concat(string0=link_kadaster_6.out0, string1=link_kadaster_6.out1, string2=link_kadaster_6.out2, string3=link_kadaster_6.out3, string4=link_kadaster_6.out4, string5=link_kadaster_6.out5, string6=link_kadaster_6.out6, string7=BoundingBox, string8=link_kadaster_6.out7, string9=link_kadaster_6.out8, string10=link_kadaster_6.out9, string11=link_kadaster_6.out10)
n15_geluids_contouren_OGC_WMS = Output(concat_8)  # "15 geluids contouren(OGC WMS)"
code_block_4 = CodeBlock()
# ---------- code_block_4.designscript (5 lines) ----------
"http://geodata.nationaalgeoregister.nl/bag/wfs?";
"service=wfs&version=2.0.0&";
"request=GetFeature&typeName=";
"bag:pand&";
"bbox=";
# ----------------------------------------
concat_9 = String.Concat(string0=code_block_4.out0, string1=code_block_4.out1, string2=code_block_4.out2, string3=code_block_4.out3, string4=code_block_4.out4, string5=BoundingBox)
n04_bag_pand_OGC_WFS = Output(concat_9)  # "04 bag pand(OGC WFS)"
link_kadaster_7 = CodeBlock()
# ---------- link_kadaster_7.designscript (11 lines) ----------
"http://geodata.nationaalgeoregister.nl/";
"cbsvierkanten100mv2/wms?";
"&request=GetMap";
"&VERSION=1.3.0";
"&STYLES=cbsvierkanten100mv2:cbsvierkanten100m_woz_waarde_woning";
"&layers=vierkant100m2016";
"&bbox=";
"&width=4000";
"&height=4000";
"&format=image/png";
"&crs=EPSG:28992";
# ----------------------------------------
concat_10 = String.Concat(string0=link_kadaster_7.out0, string1=link_kadaster_7.out1, string2=link_kadaster_7.out2, string3=link_kadaster_7.out3, string4=link_kadaster_7.out4, string5=link_kadaster_7.out5, string6=link_kadaster_7.out6, string7=BoundingBox, string8=link_kadaster_7.out7, string9=link_kadaster_7.out8, string10=link_kadaster_7.out9, string11=link_kadaster_7.out10)
n05_CBS_WOZ_2016_100m_OGC_WMS = Output(concat_10)  # "05 CBS-WOZ 2016 100m(OGC WMS)"
code_block_5 = CodeBlock()
# ---------- code_block_5.designscript (5 lines) ----------
"http://geodata.nationaalgeoregister.nl/bag/wfs?";
"service=wfs&version=2.0.0&";
"request=GetFeature&typeName=";
"bag:verblijfsobject&";
"bbox=";
# ----------------------------------------
concat_11 = String.Concat(string0=code_block_5.out0, string1=code_block_5.out1, string2=code_block_5.out2, string3=code_block_5.out3, string4=code_block_5.out4, string5=BoundingBox)
n03_bag_verblijfsobject_OGC_WFS = Output(concat_11)  # "03 bag verblijfsobject(OGC WFS)"
code_block_6 = CodeBlock()
# ---------- code_block_6.designscript (6 lines) ----------
"http://afnemers.ruimtelijkeplannen.nl/afnemers/services?";
"&service=WFS";
"&version=1.1.0";
"&request=GetFeature";
"&typeName=app:Bouwvlak";
"&bbox=";
# ----------------------------------------
concat_12 = String.Concat(string0=code_block_6.out0, string1=code_block_6.out1, string2=code_block_6.out2, string3=code_block_6.out3, string4=code_block_6.out4, string5=code_block_6.out5, string6=BoundingBox)
n02_ruimtelijke_plannen_OGC_WFS = Output(concat_12)  # "02 ruimtelijke plannen(OGC WFS)"
link_kadaster_8 = CodeBlock()
# ---------- link_kadaster_8.designscript (5 lines) ----------
"http://geodata.nationaalgeoregister.nl/";
"kadastralekaartv3/wfs?";
"&request=GetFeature";
"&typeName=kadastralekaartv3:kadastralegrens";
"&bbox=";
# ----------------------------------------
concat_13 = String.Concat(string0=link_kadaster_8.out0, string1=link_kadaster_8.out1, string2=link_kadaster_8.out2, string3=link_kadaster_8.out3, string4=link_kadaster_8.out4, string5=BoundingBox)
n01_kadastrale_grenzen_OGC_WFS = Output(concat_13)  # "01 kadastrale grenzen(OGC WFS)"

# group: luchtfoto
link_kadaster_9 = CodeBlock()
# ---------- link_kadaster_9.designscript (11 lines) ----------
"http://geodata.nationaalgeoregister.nl/";
"luchtfoto/rgb/wms?";
"&request=GetMap";
"&VERSION=1.3.0";
"&STYLES=default";
"&layers=2018_ortho25";
"&bbox=";
"&width=4000";
"&height=4000";
"&format=image/png";
"&crs=EPSG:28992";
# ----------------------------------------
concat_14 = String.Concat(string0=link_kadaster_9.out0, string1=link_kadaster_9.out1, string2=link_kadaster_9.out2, string3=link_kadaster_9.out3, string4=link_kadaster_9.out4, string5=link_kadaster_9.out5, string6=link_kadaster_9.out6, string7=BoundingBox, string8=link_kadaster_9.out7, string9=link_kadaster_9.out8, string10=link_kadaster_9.out9, string11=link_kadaster_9.out10)
n12_Luchtfoto_actueel_OGC_WMS = Output(concat_14)  # "12 Luchtfoto actueel(OGC WMS)"

link_kadaster_2018 = CodeBlock()
# ---------- link_kadaster_2018.designscript (11 lines) ----------
"http://geodata.nationaalgeoregister.nl/";
"luchtfoto/rgb/wms?";
"&request=GetMap";
"&VERSION=1.3.0";
"&STYLES=default";
"&layers=2018_ortho25";
"&bbox=";
"&width=3000";
"&height=3000";
"&format=image/png";
"&crs=EPSG:28992";
# ----------------------------------------
code_block_7 = CodeBlock { "http://geodata.nationaalgeoregister.nl/ahn2/wfs?"; "&request=GetFeature&typeName="; "ahn2_bladindex&"; "bbox="; }
concat_15 = String.Concat(string0=code_block_7.out0, string1=code_block_7.out1, string2=code_block_7.out2, string3=code_block_7.out3, string4=BoundingBox)
n13a_AHN2_webrequest_bladindex_OGC_WFS = Output(concat_15)  # "13a AHN2 webrequest bladindex(OGC WFS)"
