# Dynamo custom node GIS2BIM.GooglePlacesApi.dyf (Dynamo 2.0.3.8810)
# category: MLA+
# Google places Api

code_block = CodeBlock()
# ---------- code_block.designscript (6 lines) ----------
"https://maps.googleapis.com/maps/api/place/nearbysearch/xml?location=";
"%2C";
"&rankby=distance&";
"type=";
"bus_station";
"&key=";
# ----------------------------------------
Lat = Input(Lat: var[]..[])
code_block_2 = CodeBlock { ","; "."; }
replace = String.Replace(str=Lat, searchFor=code_block_2.out0, replaceWith=code_block_2.out1)
Lon = Input(Lon: var[]..[])
replace_2 = String.Replace(str=Lon, searchFor=code_block_2.out0, replaceWith=code_block_2.out1)
Categorie = Input(Categorie: var[]..[])
GoogleApiKey = Input(GoogleApiKey: var[]..[])
concat = String.Concat(string0=code_block.out0, string1=replace, string2=code_block.out1, string3=replace_2, string4=code_block.out2, string5=code_block.out3, string6=Categorie, string7=code_block.out5, string8=GoogleApiKey)
web_request = WebRequest(url=concat)
XML = Output(web_request)
URL = Output(concat)
