# Dynamo custom node GIS2BIM.Image_analyzer.dyf (Dynamo 2.0.2.6826)
# category: MLA+
# GIS2BIM.Image_analyzer

element = Input(element: Element)
list_of_colors = Input(list of colors: var[]..[])
x = Input(x: var[]..[])
y = Input(y: var[]..[])

# group: set WOZ and color
code_block = CodeBlock { "WOZ"; }
python_script = Python(IN[0]=list_of_colors, IN[1]=x, IN[2]=y)
# ---------- python_script.python (40 lines) ----------
# Enable Python support and load DesignScript library
import clr
clr.AddReference('ProtoGeometry')
from Autodesk.DesignScript.Geometry import *

# The inputs to this node will be stored as a list in the IN variables.
dataEnteringNode = IN
aColors= IN[0]
aX= IN[1]
aY= IN[2]
aColorsperobject= []
aDebug= []
aWOZ= []

# Place your code below this line
for i in range(len(aX)):
	aDebug.append(i)
	iX=int(aX[i])
	iY=int(aY[i])	
	sColor= aColors[iX][iY]
	aColorsperobject.append(sColor)
	iWOZ = 0
	if str(sColor) == 'Color(Red = 69, Green = 117, Blue = 181, Alpha = 255)':
		iWOZ= 100000
	if str(sColor) == 'Color(Red = 132, Green = 158, Blue = 186, Alpha = 255)':
		iWOZ= 150000
	if str(sColor) == 'Color(Red = 192, Green = 204, Blue = 190, Alpha = 255)':
		iWOZ= 200000
	if str(sColor) == 'Color(Red = 255, Green = 255, Blue = 191, Alpha = 255)':
		iWOZ= 300000
	if str(sColor) == 'Color(Red = 250, Green = 185, Blue = 132, Alpha = 255)':
		iWOZ= 500000
	if str(sColor) == 'Color(Red = 237, Green = 117, Blue = 81, Alpha = 255)':
		iWOZ= 750000
	if str(sColor) == 'Color(Red = 214, Green = 47, Blue = 39, Alpha = 255)':
		iWOZ= 1000000
	aWOZ.append(iWOZ)

# Assign your output to the OUT variable.
OUT = [aWOZ,aColorsperobject]
# ----------------------------------------
code_block_2 = CodeBlock(l=python_script) { l[1]; l[0]; }
setParameterByName = Element.SetParameterByName(element=element, parameterName=code_block, value=code_block_2.out1)
overrideColorInView = Element.OverrideColorInView(element=setParameterByName, color=code_block_2.out0)

Element = Output(overrideColorInView)
