# Dynamo custom node GIS2BIM.mass_location.dyf (Dynamo 2.0.2.6826)
# category: MLA+
# GIS2BIM.mass_location

# group: mass get location
categories = Categories(index=276)
all_elements_of_category = ElementsOfCategory(Category=categories)
Elements = Output(all_elements_of_category)
getLocation = Element.GetLocation(element=all_elements_of_category)
Geometry = Output(getLocation)
bbox = Input(bbox: var[]..[])
geometry = Element.Geometry(element=all_elements_of_category)
centroid = Solid.Centroid(solid=geometry)
X = Point.X(point=centroid)
Y = Point.Y(point=centroid)
code_block = CodeBlock(bbox=bbox, x=X, y=Y) { move=(bbox/2); xx=move+ Math.Round(x/1000); yy=move- Math.Round(y/1000); }
x = Output(code_block.xx)
Y_2 = Output(code_block.yy)  # "Y"
