# Dynamo graph MLA_GIS2BIM_WOZ_analyze.dyn (Dynamo 2.0.2.6826)

categories = Categories(index=276)
all_elements_of_category = ElementsOfCategory(Category=categories)

# group: adres
code_block = CodeBlock { 1000; }
getSharedCoordinate = Custom[GIS2BIM.GetSharedCoordinate](scale=code_block)  # Get the current shared coordinate
string = StringInput("bbox")
findByName = GlobalParameter.FindByName(name=string)
value = GlobalParameter.Value(globalParameter=findByName)
code_block_2 = CodeBlock(i=value) { i*1.5; }
watch = Watch(code_block_2)
createBoundingBox = Custom[GIS2BIM.CreateBoundingBox](CoordinateX=getSharedCoordinate.E_W, CoordinateY=getSharedCoordinate.N_S, BoxWidth=watch, BoxHeight=watch)  # create boundingboxstring for webrequests based on coördinates and dimensions

geoservicesLibraryNetherlands = Custom[GIS2BIM.GeoservicesLibraryNetherlands](BoundingBox=createBoundingBox.Boxstring)  # Library with multiple webadresses which can be used for WFS and WMS webrequests

# group: WOZ
string_2 = StringInput("GIS2BIM_WOZ")
selectByName = Custom[View.SelectByName](Viewname_string_var_var=string_2)  # select a view by its name
string_3 = StringInput("C:\TEMP\")
string_4 = StringInput("WOZ")
webrequestWMS = Custom[GIS2BIM.WebrequestWMS](WMSwebrequest=geoservicesLibraryNetherlands.6_CBS_WOZ_2011_100m_OGC_WMS, width_of_the_bounding_box_width_of_the_bounding_box_Boundingboxwidth_m_var=watch, View_var=selectByName, Tempfolder=string_3, Filename=string_4)  # imports the result(image) of a webrequest based on WMS-protocol into a view in Revit
geoservicesLibraryNetherlands_MLA = Custom[GIS2BIM.GeoservicesLibraryNetherlands_MLA](BoundingBox=createBoundingBox.Boxstring)  # GeoservicesLibraryNetherlands_MLA

# group: image analyses
fromPath = FileObject(path=webrequestWMS.path)  # "File.FromPath"
readFromFile = Image.ReadFromFile(file=fromPath)
watch_image = WatchImageCore(image=readFromFile)
pixels = Image.Pixels(image=watch_image, xSamples=watch, ySamples=watch)
watch_2 = Watch(pixels)

getLocation = Element.GetLocation(element=all_elements_of_category)
X = Point.X(point=getLocation)
Y = Point.Y(point=getLocation)
code_block_3 = CodeBlock(bbox=watch, x=X, y=Y) { move=(bbox/2); xx=move+ Math.Round(x/1000); yy=move- Math.Round(y/1000); }

# group: set WOZ and color
code_block_4 = CodeBlock { "WOZ"; }
python_script = Python(IN[0]=watch_2, IN[1]=code_block_3.yy, IN[2]=code_block_3.xx)
# ---------- python_script.python (40 lines) ----------
# Enable Python support and load DesignScript library
import clr
clr.AddReference('ProtoGeometry')
from Autodesk.DesignScript.Geometry import *

# The inputs to this node will be stored as a list in the IN variables.
dataEnteringNode = IN
aColors= IN[0]
aX= IN[1]
aY= IN[2]
aColorsperobject= []
aDebug= []
aWOZ= []

# Place your code below this line
for i in range(len(aX)):
	aDebug.append(i)
	iX=int(aX[i])
	iY=int(aY[i])	
	sColor= aColors[iX][iY]
	aColorsperobject.append(sColor)
	iWOZ = 0
	if str(sColor) == 'Color(Red = 69, Green = 117, Blue = 181, Alpha = 255)':
		iWOZ= 100000
	if str(sColor) == 'Color(Red = 132, Green = 158, Blue = 186, Alpha = 255)':
		iWOZ= 150000
	if str(sColor) == 'Color(Red = 192, Green = 204, Blue = 190, Alpha = 255)':
		iWOZ= 200000
	if str(sColor) == 'Color(Red = 255, Green = 255, Blue = 191, Alpha = 255)':
		iWOZ= 300000
	if str(sColor) == 'Color(Red = 250, Green = 185, Blue = 132, Alpha = 255)':
		iWOZ= 500000
	if str(sColor) == 'Color(Red = 237, Green = 117, Blue = 81, Alpha = 255)':
		iWOZ= 750000
	if str(sColor) == 'Color(Red = 214, Green = 47, Blue = 39, Alpha = 255)':
		iWOZ= 1000000
	aWOZ.append(iWOZ)

# Assign your output to the OUT variable.
OUT = [aWOZ,aColorsperobject]
# ----------------------------------------
code_block_5 = CodeBlock(l=python_script) { l[1]; l[0]; }
setParameterByName = Element.SetParameterByName(element=all_elements_of_category, parameterName=code_block_4, value=code_block_5.out1)
overrideColorInView = Element.OverrideColorInView(element=setParameterByName, color=code_block_5.out0)

# group: text notes
indexOf = List.IndexOf(list=all_elements_of_category, element=all_elements_of_category)
string_from_object = FromObject(obj=indexOf)
code_block_6 = CodeBlock { "Left"; "7mm"; }
getTextNoteTypeByName = archilab.Revit.Selection.Select.GetTextNoteTypeByName(name=code_block_6.out1)
byLocation = TextNote.ByLocation(view=selectByName, location=getLocation, text=string_from_object, alignment=code_block_6.out0, type=getTextNoteTypeByName)
code_block_7 = CodeBlock { "WOZ_indexes"; }
fromElements = Custom[Group.FromElements](elements=byLocation, groupName=code_block_7)  # Creates a group from a list of Revit elements

code_block_8 = CodeBlock(l=watch_2) { l[60][137]; l[52][132]; }
watch_3 = Watch(code_block_8.out0)
sendTo = Custom[Clipboard.SendTo](str=geoservicesLibraryNetherlands_MLA.05_CBS_WOZ_2016_100m_OGC_WMS)  # Copies a string to the clipboard.

# group: unique colors (legend)
flatten = List.Flatten(list=watch_2)
uniqueItems = List.UniqueItems(list=flatten)
