# Dynamo graph MLA_GIS2BIM_geluidscontouren.dyn (Dynamo 2.0.2.6826)

code_block = CodeBlock { 1000; }

# group: INPUT
string = StringInput("bbox")  # graph input
findByName = GlobalParameter.FindByName(name=string)
getValue = Custom[GlobalParameter.GetValue](globalParameter=findByName)  # Gets the value of a global parameter (only in Revit 2016 R2 or later).
code_block_2 = CodeBlock(i=getValue) { i*1.5; }
watch = Watch(code_block_2)
getSharedCoordinate = Custom[GIS2BIM.GetSharedCoordinate](scale=code_block)  # Get the current shared coordinate
string_2 = StringInput("C:\TEMP\")  # graph input
nameArialPhoto = CodeBlock { "geluidscontouren_"; }

mass_location = Custom[GIS2BIM.mass_location](bbox=watch)  # GIS2BIM.mass_location
createBoundingBox = Custom[GIS2BIM.CreateBoundingBox](CoordinateX=getSharedCoordinate.E_W, CoordinateY=getSharedCoordinate.N_S, BoxWidth=watch, BoxHeight=watch)  # create boundingboxstring for webrequests based on coördinates and dimensions
geoservicesLibraryNetherlands_MLA = Custom[GIS2BIM.GeoservicesLibraryNetherlands_MLA](BoundingBox=createBoundingBox.Boxstring)  # GeoservicesLibraryNetherlands_MLA

# group: view
code_block_3 = CodeBlock { "GIS2BIM_geluidscontouren"; }
selectByName = Custom[View.SelectByName](Viewname_string_var_var=code_block_3)  # select a view by its name

# group: filename
code_block_4 = CodeBlock { "rdx"; "rdy"; "bbox"; }
string_from_object = FromObject(obj=getSharedCoordinate.E_W)
string_from_object_2 = FromObject(obj=getSharedCoordinate.N_S)
string_from_object_3 = FromObject(obj=watch)
concat = String.Concat(string0=nameArialPhoto, string1=code_block_4.out0, string2=string_from_object, string3=code_block_4.out1, string4=string_from_object_2, string5=code_block_4.out2, string6=string_from_object_3)

# group: GET PHOTO
webrequestWMS = Custom[GIS2BIM.WebrequestWMS](WMSwebrequest=geoservicesLibraryNetherlands_MLA.15_geluids_contouren_OGC_WMS, width_of_the_bounding_box_width_of_the_bounding_box_Boundingboxwidth_m_var=watch, View_var=selectByName, Tempfolder=string_2, Filename=concat)  # imports the result(image) of a webrequest based on WMS-protocol into a view in Revit
watch_image = WatchImageCore(image=webrequestWMS.watch_image)

pixels = Image.Pixels(image=watch_image, xSamples=watch, ySamples=watch)
code_block_5 = CodeBlock()
# ---------- code_block_5.designscript (8 lines) ----------
["Color(Red = 255, Green = 255, Blue = 255, Alpha = 255)","geen geluid van wegen"];
["Color(Red = 255, Green = 255, Blue = 178, Alpha = 255)","45-50dB (goed)"];
["Color(Red = 255, Green = 255, Blue = 0, Alpha = 255)","50-55dB (redelijk)"];
["Color(Red = 255, Green = 210, Blue = 0, Alpha = 255)","55-60dB (matig)"];
["Color(Red = 255, Green = 165, Blue = 0, Alpha = 255)","60-65dB slecht)"];
["Color(Red = 255, Green = 0, Blue = 0, Alpha = 255)","65-70dB (zeer slecht)"];
["Color(Red = 192, Green = 0, Blue = 0, Alpha = 255)","70-75dB (bebouwing niet mogelijk)"];
["Color(Red = 128, Green = 0, Blue = 0, Alpha = 255)","> 75dB (bebouwing niet mogelijk)"];
# ----------------------------------------
list_create = List.Create(item0=code_block_5.out0, item1=code_block_5.out1, item2=code_block_5.out2, item3=code_block_5.out3, item4=code_block_5.out4, item5=code_block_5.out5, item6=code_block_5.out6, item7=code_block_5.out7)
flatten = List.Flatten(list=list_create)
code_block_6 = CodeBlock { 2; 1; }
takeEveryNthItem = List.TakeEveryNthItem(list=flatten, n=code_block_6.out0, offset=code_block_6.out1)
takeEveryNthItem_2 = List.TakeEveryNthItem(list=flatten, n=code_block_6.out0, offset=code_block_6.out0)

# group: set WOZ and color
code_block_7 = CodeBlock { "geluid"; }
python_script = Python(IN[0]=pixels, IN[1]=mass_location.Y, IN[2]=mass_location.x, IN[3]=takeEveryNthItem, IN[4]=takeEveryNthItem_2)
# ---------- python_script.python (38 lines) ----------
# Enable Python support and load DesignScript library
import clr
clr.AddReference('ProtoGeometry')
from Autodesk.DesignScript.Geometry import *

# The inputs to this node will be stored as a list in the IN variables.
#inputs
dataEnteringNode = IN
aColors= IN[0]
aRows= IN[1]
aCols= IN[2]
aLegenda= IN[3]
aLegendewaarde= IN[4]
#outputs
aColorsperobject= []
aDebug= []
aOUT= []

def search_2d(data, search):
    for i, e in enumerate(data):
        try:
            return i
        except ValueError:
            pass

for i in range(len(aRows)):
#	aDebug.append(i)
	iRow=int(aRows[i])
	iCol=int(aCols[i])	
	sColor= aColors[iRow][iCol]
	aColorsperobject.append(sColor)
	sWaarde = 0
	if str(sColor) >= 0:
		index= aLegenda.index(str(sColor))
		swaarde= aLegendewaarde[index]
		aOUT.append(swaarde)
	
OUT = [aOUT, aColorsperobject]
# ----------------------------------------
code_block_8 = CodeBlock(l=python_script) { l[1]; l[0]; }
setParameterByName = Element.SetParameterByName(element=mass_location.Elements, parameterName=code_block_7, value=code_block_8.out1)
overrideColorInView = Element.OverrideColorInView(element=setParameterByName, color=code_block_8.out0)

image_analyzer = Custom[GIS2BIM.Image_analyzer]()  # GIS2BIM.Image_analyzer; unwired: list_of_colors, rows, cols, elements
