# Dynamo custom node View.SelectByName.dyf (Dynamo 2.0.2.6826)
# category: MLA+
# select a view by its name

view_type = ViewTypesUi(index=9)
getByType = archilab.Revit.Views.Views.GetByType(viewType=view_type)
name = Element.Name(element=getByType)
Viewname_string_var = Input(Viewname(string): var[]..[]: var[]..[])
searchListForString = Lists.Strings.SearchListForString(Strings=name, SearchFor=Viewname_string_var)
getItemAtIndex = List.GetItemAtIndex(list=getByType, index=searchListForString.Indices)
code_block = CodeBlock(a=getItemAtIndex) { a[0]; }
view = Output(code_block)
