# Dynamo graph obj2mesh.dyn (Dynamo 1.3.2.2480)

file_path = Filename("..\TEMP\38cn2 - Cloud.obj")
importFile = Autodesk.Dynamo.MeshToolkit.Mesh.ImportFile(file_path)
vertices = Autodesk.Dynamo.MeshToolkit.Mesh.Vertices(importFile)
vertexIndicesByTri = Autodesk.Dynamo.MeshToolkit.Mesh.VertexIndicesByTri(importFile)
flatten = Flatten(vertexIndicesByTri)
code_block = CodeBlock { 3; }
chop = List.Chop(list=flatten, lengths=code_block)
transpose = List.Transpose(chop)
code_block_2 = CodeBlock(x=transpose) { IndexGroup.ByIndices(x[0],x[1],x[2]); }
byPointsFaceIndices = Mesh.ByPointsFaceIndices(vertices, code_block_2)
categories = Categories("Mass")
code_block_3 = CodeBlock { "Default"; }
byName = Material.ByName(code_block_3)
code_block_4 = CodeBlock { "terrein"; }
byMesh = DirectShape.ByMesh(byPointsFaceIndices, categories, byName, code_block_4)
