# Dynamo graph image analyses.dyn (Dynamo 1.3.2.2480)

# group: adres
code_block = CodeBlock { "Rotterdam"; "Van Nelleweg"; "3042 "; }
getLocationdataNetherlands = Custom[GIS2BIM.GetLocationdataNetherlands](City=code_block.out0, Streetname=code_block.out1, Housenumber=code_block.out2)  # Gives locationdata based on an adress in the Netherlands
code_block_2 = CodeBlock { 50; }
code_block_3 = CodeBlock(rdx=getLocationdataNetherlands.RDcoordinate_X_meters, rdy=getLocationdataNetherlands.RDcoordinate_Y_meters, bbox=code_block_2) { rdx; rdy; bbox; }

# group: BAG
views = Views("WOZ + BAG")
code_block_4 = CodeBlock(rdx=code_block_3.rdx, rdy=code_block_3.rdy, bbox=code_block_3.bbox) { rdx; rdy; bbox; }
createBoundingBox = Custom[GIS2BIM.CreateBoundingBox](CoordinateX=code_block_4.rdx, CoordinateY=code_block_4.rdy, BoxWidth=code_block_4.bbox, BoxHeight=code_block_4.bbox)  # create boundingboxstring for webrequests based on coördinates and dimensions
geoservicesLibraryNetherlands = Custom[GIS2BIM.GeoservicesLibraryNetherlands](BoundingBox=createBoundingBox.Boxstring)  # Library with multiple webadresses which can be used for WFS and WMS webrequests
web_request = WebRequest(geoservicesLibraryNetherlands.4_bag_pand_WFS)
string = StringInput(".//{http://www.opengis.net/gml/3.2}posList")
boolean = BoolSelector(true)
createPointsPolygonFromGMLxyz = Custom[GIS2BIM.CreatePointsPolygonFromGMLxyz](XML=web_request, XPATHSTRING=string, DeltaX=code_block_4.rdx, DeltaY=code_block_4.rdy, Connectpolygon=boolean)  # Create points and polygons from a xml/gml-file with x,y and z value
lineStyleBAGPand = StringInput("pen rood")
createDetailLinesFromPolygons = Custom[GIS2BIM.CreateDetailLinesFromPolygons](View=views, PolyCurves=createPointsPolygonFromGMLxyz.PolyCurves, Linestyle=lineStyleBAGPand)  # Create detaillines from polygons in a view
explode = Geometry.Explode(createPointsPolygonFromGMLxyz.PolyCurves)
filledregiontypebag_pand = FilledRegionTypes("FP_DP_90_pand")
byCurves = FilledRegion.ByCurves(views, explode, filledregiontypebag_pand)
ZAxis = Vector.ZAxis()
code_block_5 = CodeBlock { 1000; }
extrudeAsSolid = Curve.ExtrudeAsSolid(curve=createPointsPolygonFromGMLxyz.PolyCurves, direction=ZAxis, distance=code_block_5)
file_path = Filename("C:\ProgramData\Autodesk\RVT 2018\Family Templates\English\Conceptual Mass\Metric Mass.rft")
code_block_6 = CodeBlock()
# ---------- code_block_6.designscript (8 lines) ----------
"bag:identificatie";
"bag:bouwjaar";
"bag:status";
"bag:gebruiksdoel";
"bag:oppervlakte_min";
"bag:oppervlakte_max";
"bag:aantal_verblijfsobjecten";
"gml:posList";
# ----------------------------------------
getXMLNode = Lists.DataSets.GetXMLNode(web_request, code_block_6.out0)
categories = Categories("Mass")
string_2 = StringInput("Default")
byName = Material.ByName(string_2)
byGeometry = Custom[Springs.FamilyInstance.ByGeometry](geometry=extrudeAsSolid, familyTemplatePath=file_path, familyName=getXMLNode, category=categories, materialName=byName)  # You must provide a valid family template path that will be used for all input geometry objects. The project units(and not the templates) will be used to determine the size of the output geometry. The provided category will be used only if the family template supports it. If not, the default template category will be used instead. Likewise, the family material(provided as a string) will be set only if a material with that name exists in the template. If not, the default material will be used instead ("By Category"). For void cuts, the material settings will be ignored. The Subcategory name is an optional input. If you'd like to skip assigning a Subcategory to any new instance, simply use null. The node expects a unique family name for each geometry object. The rest of the input lists will be processed as if the node lacing is set to longest.
code_block_7 = CodeBlock { "bouwjaar"; "gebruiksdoel"; }
getXMLNode_2 = Lists.DataSets.GetXMLNode(web_request, code_block_6.out1)
flatten = Flatten(getXMLNode_2)
setParameterByName = Element.SetParameterByName(element=byGeometry.instance, parameterName=code_block_7.out0, value=flatten)
sendTo = Custom[Clipboard.SendTo](str=geoservicesLibraryNetherlands.4_bag_pand_WFS)  # Copies a string to the clipboard.
getXMLNode_3 = Lists.DataSets.GetXMLNode(web_request, code_block_6.out3)
flatten_2 = Flatten(getXMLNode_3)
setParameterByName_2 = Element.SetParameterByName(element=byGeometry.instance, parameterName=code_block_7.out1, value=flatten_2)
location = Custom[Element.Location](element=byGeometry.instance)  # Returns the location of an element as an XYZ (or if it's line-based the start and end point of the line), along with some booleans to help filtering the results. Use this for some element types (e.g. walls or lines) that do not work with the built-in Get Family Instance Location node.
watch = Watch(location.points)
X = Point.X(watch)
Y = Point.Y(watch)

# group: WOZ
code_block_8 = CodeBlock(rdx=code_block_3.rdx, rdy=code_block_3.rdy, bbox=code_block_3.bbox) { rdx; rdy; bbox; }
views_2 = Views("WOZ + BAG")
createBoundingBox_2 = Custom[GIS2BIM.CreateBoundingBox](CoordinateX=code_block_8.rdx, CoordinateY=code_block_8.rdy, BoxWidth=code_block_8.bbox, BoxHeight=code_block_8.bbox)
geoservicesLibraryNetherlands_2 = Custom[GIS2BIM.GeoservicesLibraryNetherlands](BoundingBox=createBoundingBox_2.Boxstring)
string_3 = StringInput("h:\temp\")
nameArialPhoto = CodeBlock { "PDOK_aerialphoto2016"; }
code_block_9 = CodeBlock { "rdx"; "rdy"; "bbox"; }
string_from_object = FromObject(code_block_8.rdx)
string_from_object_2 = FromObject(code_block_8.rdy)
string_from_object_3 = FromObject(code_block_8.bbox)
concat = String.Concat(nameArialPhoto, code_block_9.out0, string_from_object, code_block_9.out1, string_from_object_2, code_block_9.out2, string_from_object_3)
code_block_10 = CodeBlock { ".png"; }
concat_2 = String.Concat(concat, code_block_10)
concat_3 = String.Concat(string_3, concat_2)
python_script = Python(IN[0]=geoservicesLibraryNetherlands_2.6_CBS_WOZ_2011_100m_WMS, IN[1]=concat_3)
# ---------- python_script.python (13 lines) ----------
import sys
sys.path.append("C:\Program Files (x86)\IronPython 2.7\Lib")
import urllib 
from System.Net import WebClient

url= IN[0]
tempfile= IN[1]


#urlretrieve(url, tempfile)
WebClient().DownloadFile(url, tempfile)

OUT= tempfile
# ----------------------------------------
importImageInView = Custom[GIS2BIM.ImportImageInView](ImageWidthMeters=code_block_8.bbox, View=views_2, ImagePath=python_script, Deltax=code_block_8.rdx, Deltay=code_block_8.rdy)  # Import rasterimage in view
string_from_object_4 = FromObject(python_script)
watch_2 = Watch(python_script)

# group: image analyses
fromPath = FileObject(string_from_object_4)  # "File.FromPath"
readFromFile = Image.ReadFromFile(fromPath)
watch_image = WatchImageCore(readFromFile)
code_block_11 = CodeBlock { 2; }
pixels = Image.Pixels(image=readFromFile, xSamples=code_block_11, ySamples=code_block_11)
watch_3 = Watch(pixels)

code_block_12 = CodeBlock { "woz"; }
code_block_13 = CodeBlock(rdx=code_block_3.rdx, rdy=code_block_3.rdy, bbox=code_block_3.bbox) { rdx; rdy; bbox; }
code_block_14 = CodeBlock { 1000; -1000; }
mul = code_block_13.bbox * code_block_14.out0
sub = X - mul
code_block_15 = CodeBlock { -1; }
mul_2 = sub * code_block_15
div = code_block_13.bbox / code_block_11
code_block_16 = CodeBlock { 1000; }
mul_3 = div * code_block_16
div_2 = mul_2 / mul_3
floor = Math.Floor(div_2)
code_block_17 = CodeBlock { 1; }
sub_2 = floor - code_block_17
code_block_18 = CodeBlock(x=sub_2) { x[0]; }
mul_4 = code_block_13.bbox * code_block_14.out1
sub_3 = Y - mul_4
div_3 = sub_3 / mul_3
floor_2 = Math.Floor(div_3)
sub_4 = floor_2 - code_block_17
code_block_19 = CodeBlock(y=sub_4) { y[0]; }
code_block_20 = CodeBlock(list=watch_3, x=code_block_18, y=code_block_19) { list[x][y]; }
watch_4 = Watch(code_block_20)
string_from_object_5 = FromObject(watch_4)
code_block_21 = CodeBlock(string_from_object_5)
# ---------- code_block_21.designscript (25 lines) ----------
rgb;
result=[Imperative]
{

if (rgb=="Color(Red = 69, Green = 117, Blue = 181, Alpha = 255)")
{
return ="<150k";
}

elseif (rgb=="Color(Red = 69, Green = 117, Blue = 181, Alpha = 255)")
{
return="200k-300k";
}

elseif (rgb=="Color(Red = 255, Green = 255, Blue = 191, Alpha = 255)")
{
return="300k-500k";
}

else
{
return="geen waarde bekend";
}

};
# ----------------------------------------
setParameterByName_3 = Element.SetParameterByName(element=byGeometry.instance, parameterName=code_block_12, value=code_block_21.out1)
watch_5 = Watch(code_block_21.out1)
sendTo_2 = Custom[Clipboard.SendTo](str=geoservicesLibraryNetherlands_2.6_CBS_WOZ_2011_100m_WMS)

# group: basepoint to survey point X
code_block_22 = CodeBlock { x; }  # unwired: x
basePoint = Coordinates.BasePoint()
X_2 = Point.X(basePoint)

# group: basepoint to survey point Y
surveyPoint = Coordinates.SurveyPoint()
code_block_23 = CodeBlock { y; }  # unwired: y
Y_2 = Point.Y(basePoint)
Y_3 = Point.Y(surveyPoint)
sub_5 = Y_2 - Y_3
add = code_block_23 + sub_5

# group (continued): basepoint to survey point X
X_3 = Point.X(surveyPoint)
sub_6 = X_2 - X_3
add_2 = code_block_22 + sub_6
