# Dynamo custom node view.create.dyf (Dynamo 1.3.2.2480)
# category: KC.view

view_type = ViewTypesUI("FloorPlan")
getByType = Archilab.Grimshaw.Views.View.GetByType(view_type)
string_from_array = FromArray(getByType)
viewname = Input()
boolean = BoolSelector(false)
contains = String.Contains(str=string_from_array, searchFor=viewname, ignoreCase=boolean)
levels = Levels("Level 1")
python_script = Python(IN[0]=contains, IN[1]=viewname, IN[2]=levels)
# ---------- python_script.python (42 lines) ----------
#Copyright(c) Jochem Kolthof
import clr
clr.AddReference('ProtoGeometry')
from Autodesk.DesignScript.Geometry import *
# Import DocumentManager and TransactionManager
clr.AddReference("RevitServices")
import RevitServices
from RevitServices.Persistence import DocumentManager
from RevitServices.Transactions import TransactionManager
doc = DocumentManager.Instance.CurrentDBDocument
uiapp = DocumentManager.Instance.CurrentUIApplication
app = uiapp.Application
# Import ToDSType(bool) extension method
clr.AddReference("RevitNodes")
import Revit
clr.ImportExtensions(Revit.Elements)
# Import RevitAPI
clr.AddReference("RevitAPI")
import Autodesk
from Autodesk.Revit.DB import *

dataEnteringNode = IN
bool=IN[0]
viewnaam=IN[1]
level = UnwrapElement(IN[2])

if bool == False:
	viewTypes = FilteredElementCollector(doc).OfClass(ViewFamilyType)
	for i in viewTypes:
		if i.ViewFamily == ViewFamily.FloorPlan:
			viewTypeId = i.Id
			TransactionManager.Instance.EnsureInTransaction(doc)
			view = ViewPlan.Create(doc, viewTypeId, level.Id)
			view.ViewName = viewnaam
			output = view.ViewName
			break
		else:
			continue		
else:
	output = viewnaam

OUT = output
# ----------------------------------------
Output = Output(python_script)  # ""
